# Grasshopper definition WaveFunctionCollapse_test.gh (Grasshopper 1.0.4)
# plug-ins: WaveFunctionCollapse

panel = Panel("FULL TILE")
full_tile = Surface(graft([<surface referenced from the Rhino model> x5]))
box_corners = BoxCorners(Box=full_tile)  # -> CornerA, CornerB, CornerC, CornerD, CornerE, CornerF, CornerG, CornerH
average = Average(Input=[box_corners.CornerC, box_corners.CornerA, box_corners.CornerB, box_corners.CornerD])  # -> flatten(ArithmeticMean)
panel_2 = Panel(average)

panel_3 = Panel("Sample Tile Size")
tiles_area = Surface(<surface referenced from the Rhino model>)
dimensions = Dimensions(Surface=tiles_area)  # -> UDimension, VDimension
divide_surface = DivideSurface(Surface=tiles_area, UCount=dimensions.UDimension, VCount=dimensions.VDimension)  # -> flatten(Points), Normals, Parameters
c_script = CSharpScript(PointsX=divide_surface.Points)  # -> out, flatten(A), B; inputs PointsX: list of Point3d
# ---------- c_script: C# ----------
    var res = new List<Point3d>();

    for (int i = 0; i < PointsX.Count; i++)
    {

      if (Convert.ToInt32(PointsX[i].X) % 2 != 0 && Convert.ToInt32(PointsX[i].Y) % 2 != 0)
      {
        res.Add(PointsX[i]);
      }

    }

    A = res;

    B = PointsX.Count;
# ---------- end c_script ----------

panel_4 = Panel("HALF TILE")
half_tile = Surface(graft([<surface referenced from the Rhino model> x6]))
box_corners_2 = BoxCorners(Box=half_tile)  # -> CornerA, CornerB, CornerC, CornerD, CornerE, CornerF, CornerG, CornerH
average_2 = Average(Input=[box_corners_2.CornerB, box_corners_2.CornerA, box_corners_2.CornerC, box_corners_2.CornerD])  # -> flatten(ArithmeticMean)
panel_5 = Panel(average_2)

tiles_area_2 = Surface(<surface referenced from the Rhino model>)
dimensions_2 = Dimensions(Surface=tiles_area_2)  # -> UDimension, VDimension
divide_surface_2 = DivideSurface(Surface=tiles_area_2, UCount=dimensions_2.UDimension, VCount=dimensions_2.VDimension)  # -> flatten(Points), Normals, Parameters
panel_6 = Panel(dimensions_2.UDimension)
c_script_2 = CSharpScript(PointsX=divide_surface_2.Points)  # -> out, flatten(A), B; inputs PointsX: list of Point3d; same code as c_script
list_length = ListLength(List=c_script_2.A)
subtraction = Subtraction(A=list_length, B="1")
list_item = ListItem(List=c_script_2.A, Index=Slider(0, range=0..100), Wrap=True)
list_item_2 = ListItem(List=c_script_2.A, Index=subtraction, Wrap=True)
panel_7 = Panel(c_script_2.A)
deconstruct = Deconstruct(Point=list_item_2)  # -> XComponent, YComponent, ZComponent
panel_8 = Panel(c_script.A)
deconstruct_2 = Deconstruct(Point=list_item)  # -> XComponent, YComponent, ZComponent
wavefunctioncollapse = WaveFunctionCollapse(TileTypeA=average_2, TileTypeB=average, WholeTilePoints=c_script.A, Wave=c_script_2.A)  # -> NullsInTileset, NumberOfRotatedTiles, PanelTexts, HalfTiles, FullTiles, EmptyTiles, SeedPattern
panel_9 = Panel(deconstruct_2.XComponent)
number_slider = Slider(2, range=0..10)
number_slider_2 = Slider(2, range=0..10)
subtraction_2 = Subtraction(A=deconstruct.XComponent, B=deconstruct_2.XComponent)
subtraction_3 = Subtraction(A=deconstruct.YComponent, B=deconstruct_2.YComponent)
panel_10 = Panel(subtraction_2)
panel_11 = Panel(subtraction_3)
number_slider_3 = Slider(3, range=0..10)
division = Division(A=subtraction_2, B="2")
division_2 = Division(A=subtraction_3, B="2")
deconstruct_3 = Deconstruct(Point=wavefunctioncollapse.SeedPattern)  # -> XComponent, YComponent, ZComponent

# ---- group: HALF TILE POINTS
deconstruct_4 = Deconstruct(Point=wavefunctioncollapse.HalfTiles)  # -> XComponent, YComponent, ZComponent
vector_xyz = VectorXYZ(XComponent=deconstruct_4.XComponent, YComponent=deconstruct_4.YComponent, ZComponent=deconstruct_4.ZComponent)  # -> Vector, Length
tile_b = Surface(<surface referenced from the Rhino model>)
sphere = Sphere(Base=wavefunctioncollapse.HalfTiles, Radius=Slider(0.2, range=0..1))
c_script_3 = CSharpScript(Surface=tile_b, Vector=vector_xyz.Vector)  # -> out, A; inputs Surface: Surface, Vector: Vector3d
# ---------- c_script_3: C# ----------
    var copy = Surface.Duplicate();
    copy.Translate(Vector);

    A = copy;
# ---------- end c_script_3 ----------
custom_preview = CustomPreview(Geometry=c_script_3.A, Material=ColourSwatch(SwatchColor=RGB(204, 94, 160)))

# ---- group: FULL TILE POINTS
deconstruct_5 = Deconstruct(Point=wavefunctioncollapse.FullTiles)  # -> XComponent, YComponent, ZComponent
vector_xyz_2 = VectorXYZ(XComponent=deconstruct_5.XComponent, YComponent=deconstruct_5.YComponent, ZComponent=deconstruct_5.ZComponent)  # -> Vector, Length
tile_a = Surface(<surface referenced from the Rhino model>)
sphere_2 = Sphere(Base=wavefunctioncollapse.FullTiles, Radius=Slider(0.2, range=0..1))
c_script_4 = CSharpScript(Surface=tile_a, Vector=vector_xyz_2.Vector)  # -> out, A; inputs Surface: Surface, Vector: Vector3d; same code as c_script_3
custom_preview_2 = CustomPreview(Geometry=c_script_4.A, Material=ColourSwatch(SwatchColor=RGB(32, 72, 145)))

# ---- group: NULL TILES
deconstruct_6 = Deconstruct(Point=wavefunctioncollapse.EmptyTiles)  # -> XComponent, YComponent, ZComponent
vector_xyz_3 = VectorXYZ(XComponent=deconstruct_6.XComponent, YComponent=deconstruct_6.YComponent, ZComponent=deconstruct_6.ZComponent)  # -> Vector, Length
tile_a_2 = Surface(<surface referenced from the Rhino model>)
sphere_3 = Sphere(Base=wavefunctioncollapse.EmptyTiles, Radius=Slider(0.2, range=0..1))
c_script_5 = CSharpScript(Surface=tile_a_2, Vector=vector_xyz_3.Vector)  # -> out, A; inputs Surface: Surface, Vector: Vector3d; same code as c_script_3
custom_preview_3 = CustomPreview(Geometry=c_script_5.A, Material=ColourSwatch(SwatchColor=RGB(143, 141, 150)))

# ----
addition = Addition(A=division, B="1")
addition_2 = Addition(A=division_2, B="1")
vector_xyz_4 = VectorXYZ(XComponent=deconstruct_3.XComponent, YComponent=deconstruct_3.YComponent, ZComponent=deconstruct_3.ZComponent)  # -> Vector, Length
tile_a_3 = Surface(<surface referenced from the Rhino model>)
panel_12 = Panel(addition_2)
panel_13 = Panel(addition)
sphere_4 = Sphere(Base=wavefunctioncollapse.SeedPattern, Radius=Slider(0.2, range=0..1))
panel_14 = Panel(vector_xyz_4.Vector)
c_script_6 = CSharpScript(Surface=tile_a_3, Vector=vector_xyz_4.Vector)  # -> out, A; inputs Surface: Surface, Vector: Vector3d; same code as c_script_3
custom_preview_4 = CustomPreview(Geometry=c_script_6.A, Material=ColourSwatch(SwatchColor=RGB(77, 33, 235)))
